# Grasshopper definition viz_stiffness_checker_search_history.ghx (Grasshopper 1.0.7)
# plug-ins: karambaGH

python = PythonScript()  # -> rhino_doc_dir, extrusion_instance_dir, extrusion_plan_dir, extrusion_log_dir
# ---------- python: Python ----------
import scriptcontext as sc
from os import path

rhino_doc_dir = path.abspath(path.dirname(sc.doc.Path))
extrusion_instance_dir = path.join(rhino_doc_dir, '..', '..', \
    'assembly_instances', 'extrusion')
extrusion_plan_dir = path.join(rhino_doc_dir, '..', 'extrusion_results')
extrusion_log_dir = path.join(rhino_doc_dir, '..', 'extrusion_log')
# ---------- end python ----------

# ---- group: load log json
concatenate = Concatenate(Fragment_A=python.extrusion_log_dir, A="\", Fragment_B="voronoi_S1_03-14-2019_w_layer_log_regression-z.json")
ghpython_script = GhPythonScript(seq_result_file_path=concatenate)  # -> out, seq_e_ids
# ---------- ghpython_script: Python ----------
import rhinoscriptsyntax as rs
import json

import Grasshopper.DataTree as datatree
import System

with open(seq_result_file_path, 'r') as f:
    json_data = json.loads(f.read())

search_log_data = json_data['search_log_data']
print('search method: {}'.format(search_log_data['search_method']))
print('heuristic: {}'.format(search_log_data['heuristic']))

queue_ids_tree = datatree[System.Object]()
queue_scores_tree = datatree[System.Object]()

for search_data in search_log_data['search']:
    queue_ids = []
    queue_scores = []
# ---------- end ghpython_script ----------

# ---- group: load plan json
concatenate_2 = Concatenate(Fragment_A=python.extrusion_plan_dir, A="\", Fragment_B="voronoi_solution_regression-z.json")
ghpython_script_2 = GhPythonScript(seq_result_file_path=concatenate_2)  # -> out, seq_e_ids
# ---------- ghpython_script_2: Python ----------
__author__ = "harry"
__version__ = "2019.08.22"

import rhinoscriptsyntax as rs
import json

with open(seq_result_file_path, 'r') as f:
    json_data = json.loads(f.read())

seq_e_ids = json_data['plan']
del json_data['plan']
print(json_data)
# ---------- end ghpython_script_2 ----------

# ----
concatenate_3 = Concatenate(Fragment_A=python.extrusion_instance_dir, A="\", Fragment_B="voronoi_S1_03-14-2019_w_layer.json")
panel = Panel(ghpython_script.out)
integer = Integer(reverse(ghpython_script_2.seq_e_ids))
list_item = ListItem(List=integer, Index=Slider(24, range=0..305), Wrap=True)
ghpython_script_3 = GhPythonScript(frame_json_file_path=concatenate_3, scale=Slider(1, range=0..1000))  # -> out, all_nodes, all_elements, simplify(all_element_node_ids), all_fix_node_ids, material_name, E, E_unit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
# ---------- ghpython_script_3: Python ----------
import rhinoscriptsyntax as rs
import Rhino.Geometry as rg
from Grasshopper import DataTree as datatree
from Grasshopper.Kernel.Data import GH_Path as ghpath
import System
import math

from ghpythonlib.treehelpers import list_to_tree, tree_to_list
from compas.rpc import Proxy
cm = Proxy('pyconmech.frame_analysis.frame_file_io')

def rvector2list(rv):
    return [rv.X, rv.Y, rv.Z]

frame_info = cm.read_frame_json(frame_json_file_path, verbose=True)

node_points, element_vids, fix_node_ids, fix_specs, model_type, material_dicts, model_name = frame_info

all_nodes = [rs.CreatePoint(scale*pt[0], scale*pt[1], scale*pt[2]) for pt in node_points]
all_elements = [rg.Line(all_nodes[n1], all_nodes[n2]) for n1, n2 in element_vids]

all_element_node_ids = list_to_tree(element_vids)
all_fix_node_ids = [int(v) for v in fix_node_ids]

material_name = material_dicts[0]['material_name']
E = material_dicts[0]['youngs_modulus']
E_unit = material_dicts[0]['youngs_modulus_unit']

G = material_dicts[0]['shear_modulus']
G_unit = material_dicts[0]['shear_modulus_unit']

if 'tensile_yeild_stress' in material_dicts[0]:
    sigma = material_dicts[0]['tensile_yeild_stress']
    sigma_unit = material_dicts[0]['tensile_yeild_stress_unit']

rho = material_dicts[0]['density']
rho_unit = material_dicts[0]['density_unit']

r = math.sqrt(material_dicts[0]['cross_sec_area'] / math.pi)
r_unit = 'centimeter'
# ---------- end ghpython_script_3 ----------
split_list = SplitList(List=integer, Index=Slider(0, range=0..307))  # -> flatten(ListA), ListB
data = Data(ghpython_script_3.G_unit)
data_2 = Data(ghpython_script_3.material_name)
data_3 = Data(ghpython_script_3.E)
data_4 = Data(ghpython_script_3.E_unit)
data_5 = Data(ghpython_script_3.G)
data_6 = Data(ghpython_script_3.r)
data_7 = Data(ghpython_script_3.sigma)
data_8 = Data(ghpython_script_3.rho)
data_9 = Data(ghpython_script_3.sigma_unit)
data_10 = Data(ghpython_script_3.rho_unit)
data_11 = Data(ghpython_script_3.r_unit)
panel_2 = Panel(data_3)
panel_3 = Panel(data_5)
panel_4 = Panel(data_4)
panel_5 = Panel(data_11)
panel_6 = Panel(data_10)
panel_7 = Panel(data_2)
panel_8 = Panel(data)
panel_9 = Panel(data_7)
panel_10 = Panel(data_8)
panel_11 = Panel(data_9)
panel_12 = Panel(data_6)
point = Point(ghpython_script_3.all_nodes)
curve = Curve(ghpython_script_3.all_elements)
list_length = ListLength(List=curve)
series = Series(Start=0, Step=1, Count=list_length)
replace_items = ReplaceItems(List=series, Indices=list_item, Wrap=False)
integer_2 = Integer(replace_items)
integer_3 = Integer(integer_2)
ghpython_script_4 = GhPythonScript(
    existing_e_ids=integer_3,
    all_element_node_ids=ghpython_script_3.all_element_node_ids,
    all_fix_node_ids=ghpython_script_3.all_fix_node_ids)  # -> out, exist_fix_node_ids; inputs existing_e_ids: list of Int32, all_element_node_ids: tree of Int32, all_fix_node_ids: list of Int32
# ---------- ghpython_script_4: Python ----------
from ghpythonlib.treehelpers import list_to_tree, tree_to_list

element_vids = tree_to_list(all_element_node_ids, lambda x : x)
existing_e_ids = existing_e_ids or list(range(len(element_vids)))

existing_node_ids = set()
for e_id, e_tuple in enumerate(element_vids):
    if e_id in existing_e_ids:
        existing_node_ids.update(e_tuple)

print(all_fix_node_ids)

exist_fix_node_ids = [int(v) for v in all_fix_node_ids if v in existing_node_ids]

#existing_elements = datatree[System.Object]()
#for e_id in existing_ids:
#    existing_elements.Add(rg.Line(all_nodes[element_vids[e_id][0]], all_nodes[element_vids[e_id][1]]), ghpath(e_id))
#
#existing_nodes = datatree[System.Object]()
#for n_id in existing_node_ids:
#    existing_nodes.Add(all_nodes[n_id], ghpath(n_id))
# ---------- end ghpython_script_4 ----------
list_item_2 = ListItem(List=curve, Index=integer_3, Wrap=True)
material_properties_karamba3d = MaterialPropertiesKaramba3D(
    FamilyOfMaterial=panel_7,
    Name="0",
    YoungsModulus_kN_cm2=panel_2,
    InPlaneShearModulus_kN_cm2=panel_3,
    TransverseShearModulus_kN_cm2=panel_3,
    SpecificWeight_kN_m3=panel_10,
    CoefficientOfThermalExpansion_1_C=1e-05,
    YieldStrength_kN_cm2=Slider(23.5, range=0..100),
    mode="Isotrop")
material_properties_karamba3d_2 = MaterialPropertiesKaramba3D(
    FamilyOfMaterial="Steel",
    Name="S235",
    YoungsModulus_kN_cm2=21000,
    InPlaneShearModulus_kN_cm2=8076,
    TransverseShearModulus_kN_cm2=8076,
    SpecificWeight_kN_m3=78.5,
    CoefficientOfThermalExpansion_1_C=1e-05,
    YieldStrength_kN_cm2=23.5,
    mode="Isotrop")
curve_2 = Curve(list_item_2)
end_points = EndPoints(Curve=curve_2)  # -> Start, End

# ---- group: highlight removed elements
integer_4 = Integer(list_item)
list_item_3 = ListItem(List=curve, Index=integer_4, Wrap=True)
pipe = Pipe(Curve=list_item_3, Radius=Slider(0.002, range=0..0.005), Caps=0)
colour_cmyk = ColourCMYK(Cyan=Slider(1, range=0..1), Magenta=0, Yellow=0, Key=0)
custom_preview = CustomPreview(Geometry=pipe, Material=colour_cmyk)

# ----
remove_duplicate_points_karamba3d = RemoveDuplicatePointsKaramba3D(Point=[end_points.Start, end_points.End], LimitDistance=0.005)  # -> OutPoint, Info, Indexes
panel_13 = Panel(material_properties_karamba3d)
panel_14 = Panel(material_properties_karamba3d_2)
point_2 = Point(remove_duplicate_points_karamba3d.OutPoint)
integer_5 = Integer(ghpython_script_4.exist_fix_node_ids)

# ----
# all nodes
point_3 = Point(point)

list_item_4 = ListItem(List=point_3, Index=integer_5, Wrap=True)

# ----
# existing nodes
point_4 = Point(flatten(point_2))

# ----
# existing elements
curve_3 = Curve(flatten(curve_2))

# ----
# grounded nodes
point_5 = Point(list_item_4)

cluster = Cluster_3(model=curve_3)
point_6 = Point(point_4)
cluster_2 = Cluster_4(pts=point_6, target_pts=point_5, list=point_6)
curve_4 = Curve(curve)
integer_6 = Integer(ghpython_script_3.all_fix_node_ids)
point_7 = Point(point)
list_item_5 = ListItem(List=point_7, Index=integer_6, Wrap=True)
number = Number(panel_12)
curve_5 = Curve(curve_3)
curve_6 = Curve(curve_4)
number_2 = Number(panel_12)
cluster_3 = Cluster_2(point=point_5, point_2=point_6, line=curve_5, material=material_properties_karamba3d, thickness=number)  # -> result, data, result_2, keys, elastic_energy_knm, calculated_model
max_deformation_l2_on_trans = Panel(cluster_3.keys)
model_view_karamba3d = ModelViewKaramba3D(Model=cluster_3.calculated_model, LoadCaseFactorsForLinearSuperposition=1, IndexOfVisibleLoadcase=-1)  # -> Model, DeformedMesh, DeformedAxes, DeformedModel
beam_view_karamba3d = BeamViewKaramba3D(Model=model_view_karamba3d.Model)  # -> Model, MeshesOfRenderedBeams, DeformedBeamAxes, LegendColors, LegendTags
legend = Legend(Colour=beam_view_karamba3d.LegendColors, Tags=beam_view_karamba3d.LegendTags, LegendType=1)
cluster_4 = Cluster_2(point=list_item_5, point_2=point_7, line=curve_6, material=material_properties_karamba3d, thickness=number)  # -> result, data, result_2, keys, elastic_energy_knm, calculated_model

full_structure_compliance = Panel(cluster_4.elastic_energy_knm)
partial_structure_compliance = Panel(cluster_3.elastic_energy_knm)

internal_froce_kn_moment_kn_m = Panel(cluster_3.result)
reaction_force_kn_reaction_moment_kn_m = Panel(cluster_3.result_2)
nodal_displacement_m_rad = Panel(cluster_3.data)

# ==== cluster Cluster_2
point = ClusterInput()
material = ClusterInput()
thickness = ClusterInput()
line = ClusterInput()
point_2 = ClusterInput()
point_3 = Point(point)
# Gravity load
unit_z = UnitZ(Factor=1)
# Supports
support_karamba3d = SupportKaramba3D(PosInd=point_3, menu=[buttons(on, on, on, on, on, on)])
negative = Negative(Value=unit_z)
multiplication = Multiplication(A=thickness, B="2")
loads_karamba3d = LoadsKaramba3D(Vector=negative, LCase=0, mode="Gravity")
support_karamba3d_2 = SupportKaramba3D(support_karamba3d)
cross_section_karamba3d = CrossSectionKaramba3D(
    FamilyNameOfCrossSection="DefaultCroSec",
    Material=material,
    Diameter_cm=multiplication,
    WallThickness_cm=thickness,
    mode="Circular Hollow")
point_4 = Point(point_2)
line_to_beam_karamba3d = LineToBeamKaramba3D(Line=line, CrossSection=cross_section_karamba3d, Points=point_4, New=True, Remove=True, LimitDistance_m=0.005)  # -> Element, Points, Info
load_karamba3d = LoadKaramba3D(loads_karamba3d)
assemble_model_karamba3d = AssembleModelKaramba3D(
    Point=point_4,
    Elem=line_to_beam_karamba3d.Element,
    Support=support_karamba3d_2,
    Load=load_karamba3d,
    LimitDistance_m=0.005)  # -> Model, Info, Mass_kg, CenterOfGravity
analyze_karamba3d = AnalyzeKaramba3D(Model=assemble_model_karamba3d.Model)  # -> CalculatedModel, MaximumDisplacement_cm, ResultingForceOfGravity_kN, ElasticEnergy_kNm
reaction_forces_karamba3d = ReactionForcesKaramba3D(AnalyzedModel=analyze_karamba3d.CalculatedModel, LoadCase=0)  # -> AnalyzedModel, ReactionForces_kN, ReactionMoments_kNm, SupportPosition, SumOfReactionForces_kN, SumOfReactionMoments_kNm
nodal_displacements_karamba3d = NodalDisplacementsKaramba3D(AnalyzedModel=analyze_karamba3d.CalculatedModel, LoadCase=0)  # -> AnalyzedModel, NodalTranslations_m, NodalRotations_rad
beam_forces_karamba3d = BeamForcesKaramba3D(
    AnalyzedModel=analyze_karamba3d.CalculatedModel,
    LCase=-1,
    MaximumDistanceBetweenResults_m=-1,
    NumberOfResultsPerBeamElement=2)  # -> AnalyzedModel, NormalForce_kN, ShearForceVz_kN, ShearForceVy_kN, BendingMomentMt_kNm, BendingMomentMy_kNm, BendingMomentMz_kNm
deconstruct = Deconstruct(Point=simplify(graft(reaction_forces_karamba3d.ReactionForces_kN)))  # -> XComponent, YComponent, ZComponent
deconstruct_2 = Deconstruct(Point=simplify(graft(reaction_forces_karamba3d.ReactionMoments_kNm)))  # -> XComponent, YComponent, ZComponent
merge = Merge(
    Data1=simplify(graft(nodal_displacements_karamba3d.NodalTranslations_m)),
    Data2=simplify(graft(nodal_displacements_karamba3d.NodalRotations_rad)))
evaluate = Evaluate(Expression="format(\"{0:E} {1:E} {2:E}\",x.x,x.y,x.z)", x=merge)
merge_2 = Merge(
    Data1=deconstruct.XComponent,
    Data2=deconstruct.YComponent,
    Data3=deconstruct.ZComponent,
    Data4=deconstruct_2.XComponent,
    Data5=deconstruct_2.YComponent,
    Data6=deconstruct_2.ZComponent)
merge_3 = Merge(
    Data1=graft(beam_forces_karamba3d.NormalForce_kN),
    Data2=graft(beam_forces_karamba3d.ShearForceVz_kN),
    Data3=graft(beam_forces_karamba3d.ShearForceVy_kN),
    Data4=graft(beam_forces_karamba3d.BendingMomentMt_kNm),
    Data5=graft(beam_forces_karamba3d.BendingMomentMy_kNm),
    Data6=graft(beam_forces_karamba3d.BendingMomentMz_kNm))  # -> simplify(Result)
evaluate_2 = Evaluate(Expression="format(\"{0:E}\",x)", x=merge_2)
cluster = Cluster(text=evaluate, separators=" ")
evaluate_3 = Evaluate(Expression="format(\"{0:E}\",x)", x=merge_3)
reaction_force_kn_reaction_moment_kn_m = Panel(merge_2)
shift_paths = ShiftPaths(Data=cluster, Offset=-1)
list_item = ListItem(List=shift_paths, Index=0, Wrap=True)  # -> Item, Item1, Item2
froce_kn_moment_kn_m = Panel(merge_3)
nodal_displacement_m_rad = Panel(shift_paths)
merge_4 = Merge(Data1=list_item.Item, Data2=list_item.Item1, Data3=list_item.Item2)
number = Number(merge_4)
square = Square(Value=number)
mass_addition = MassAddition(Input=square)  # -> Result, PartialResults
square_root = SquareRoot(Value=mass_addition.Result)  # -> flatten(Result)
sort_list = SortList(Keys=square_root)  # -> reverse(Keys), ValuesValuesA
elastic_energy_knm = ClusterOutput(analyze_karamba3d.ElasticEnergy_kNm)
calculated_model = ClusterOutput(analyze_karamba3d.CalculatedModel)
result = ClusterOutput(merge_3)
data = ClusterOutput(shift_paths)
result_2 = ClusterOutput(merge_2)
keys = ClusterOutput(sort_list.Keys)

# ==== cluster Cluster_3
curve = Curve()
model = ClusterInput()
entwine = Entwine(Branch00=curve, FlattenInputs=True)
# element id shower
c_script = CSharpScript(model=model, layers=entwine)  # -> out, A, edge_layer_list; inputs model: list of Curve, layers: tree of Curve
# ---------- c_script: C# usings ----------
using System.IO;
using System.Linq;
using System.Data;
using System.Drawing;
using System.Reflection;
using System.Windows.Forms;
using System.Xml;
using System.Xml.Linq;
using System.Runtime.InteropServices;

using Rhino.DocObjects;
using Rhino.Collections;
using GH_IO;
using GH_IO.Serialization;
# ---------- c_script: C# ----------
    DataTree<int> index_tree = new DataTree<int>();
    List<int> edge_layer = new List<int>(new int[model.Count()]);

    foreach(var path in layers.Paths)
    {
      foreach(var line in layers.Branch(path.Indices))
      {
        for(int i = 0; i < model.Count(); i++)
        {
          var compare_line = model[i];

          if(line.PointAt(0) == compare_line.PointAt(0))
          {
            if(line.PointAt(1) == compare_line.PointAt(1))
            {
              index_tree.Add(i, path);
              edge_layer[i] = path.Indices[0];
              //              GH_Path p = new GH_Path(0);
              //              p.Indices
              continue;
            }
          }

          if(line.PointAt(0) == compare_line.PointAt(1))
          {
            if(line.PointAt(1) == compare_line.PointAt(0))
            {
              index_tree.Add(i, path);
              edge_layer[i] = path.Indices[0];
              continue;
            }
          }
        }
      }
    }

    A = index_tree;
    edge_layer_list = edge_layer;
# ---------- end c_script ----------
list_item = ListItem(List=model, Index=c_script.A, Wrap=True)
panel = Panel(c_script.A)
ghpython_script = GhPythonScript(x=panel)  # -> out, a; inputs x: list
# ---------- ghpython_script: Python ----------
__author__ = "harry"
__version__ = "2019.08.22"

import rhinoscriptsyntax as rs

print([int(v) for v in x])
# ---------- end ghpython_script ----------

# ==== cluster Cluster_4
pts = ClusterInput()
target_pts = ClusterInput()
c_script = CSharpScript(pts=pts, target_pts=target_pts, dist_tol=0.001)  # -> out, A; inputs pts: list of Point3d, target_pts: list of Point3d, dist_tol: Double; disabled
# ---------- c_script: C# usings ----------
using System.IO;
using System.Linq;
using System.Data;
using System.Drawing;
using System.Reflection;
using System.Windows.Forms;
using System.Xml;
using System.Xml.Linq;
using System.Runtime.InteropServices;

using Rhino.DocObjects;
using Rhino.Collections;
using GH_IO;
using GH_IO.Serialization;
# ---------- c_script: C# ----------
    List<int> id = new List<int>();

    foreach(Point3d t_pt in target_pts)
    {
      for(int i = 0; i < pts.Count(); i++)
      {
        if(t_pt.DistanceTo(pts[i]) < dist_tol)
        {
          id.Add(i);
          break;
        }
      }
    }

    A = id;
# ---------- end c_script ----------
list = ClusterInput()
list_item = ListItem(List=list, Index=c_script.A, Wrap=True)  # disabled

# ==== cluster Cluster
text = ClusterInput()
separators = ClusterInput()
text_split = TextSplit(Text=text, Separators=separators)
number = Number(text_split)
clean_tree = CleanTree(RemoveNulls=True, RemoveInvalid=True, RemoveEmpty=False, Tree=number)
tree = ClusterOutput(clean_tree)
